# Grasshopper definition laser box cutout generator - no lid.gh (Grasshopper 1.0.8)
# plug-ins: LunchBox

material_thickness = Slider(3, range=1..6)
depth = Slider(36, range=1..100)
x_divisions = Slider(3, range=1..8)
y_divisions = Slider(2, range=1..8)
z_divisions = Slider(2, range=1..8)
width = Slider(55, range=1..100)
length = Slider(48, range=1..100)

# ---- group: Bake Outlines
boolean_toggle = BooleanToggle(False)

# ----
expression = Expression(x=x_divisions, Expression="x*2+1")
cluster = Cluster_2(A=length)
cluster_2 = Cluster_2(A=width)
cluster_3 = Cluster_2(A=depth)
expression_2 = Expression(x=y_divisions, Expression="x*2+1")
expression_3 = Expression(x=z_divisions, Expression="x*2+1")
construct_point = ConstructPoint(XCoordinate=cluster_2, YCoordinate=cluster, ZCoordinate=0)
yz_plane = YZPlane(Origin=Point(0, 0, 0))
xz_plane = XZPlane(Origin=Point(0, 0, 0))
mirror = Mirror(Geometry=construct_point, Plane=yz_plane)  # -> Geometry, Transform
mirror_2 = Mirror(Geometry=construct_point, Plane=xz_plane)  # -> Geometry, Transform
line = Line(StartPoint=construct_point, EndPoint=mirror.Geometry)
line_2 = Line(StartPoint=construct_point, EndPoint=mirror_2.Geometry)
expression_4 = Expression(x=material_thickness, Expression="{0, -x, 0}")
divide_curve = DivideCurve(Curve=line, Count=expression, Kinks=False)  # -> Points, Tangents, Parameters
list_length = ListLength(List=divide_curve.Points)
expression_5 = Expression(x=list_length, Expression="Format(\"(1, {0})\", x-2)")
divide_curve_2 = DivideCurve(Curve=line_2, Count=expression_2, Kinks=False)  # -> Points, Tangents, Parameters
list_length_2 = ListLength(List=divide_curve_2.Points)
expression_6 = Expression(x=list_length_2, Expression="Format(\"(1, {0})\", x-2)")
sub_list = SubList(List=divide_curve_2.Points, Domain=expression_6, Wrap=True)  # -> List, Index
expression_7 = Expression(x=material_thickness, Expression="{-x, 0, 0}")
move = Move(Geometry=divide_curve.Points, Motion=expression_4)  # -> Geometry, Transform
sub_list_2 = SubList(List=divide_curve.Points, Domain=expression_5, Wrap=True)  # -> List, Index
multiplication = Multiplication(A=material_thickness, B="-1")
multiplication_2 = Multiplication(A=material_thickness, B="-1")
move_2 = Move(Geometry=divide_curve_2.Points, Motion=expression_7)  # -> Geometry, Transform
list_length_3 = ListLength(List=move_2.Geometry)
list_length_4 = ListLength(List=move.Geometry)
vector_xyz = VectorXYZ(XComponent=multiplication, YComponent=0, ZComponent=0)  # -> Vector, Length
list_item = ListItem(List=move_2.Geometry, Index="0", Wrap=True)
list_item_2 = ListItem(List=move.Geometry, Index=0, Wrap=True)
vector_xyz_2 = VectorXYZ(XComponent=0, YComponent=multiplication_2, ZComponent=0)  # -> Vector, Length
subtraction = Subtraction(A=list_length_3, B="1")
cluster_4 = Cluster_3(y_coordinate=cluster, count=expression_3, d=depth, x=cluster_2, x_2=material_thickness)  # -> weave_2, point
subtraction_2 = Subtraction(A=list_length_4, B="1")
move_3 = Move(Geometry=list_item_2, Motion=vector_xyz.Vector)  # -> Geometry, Transform
list_item_3 = ListItem(List=move_2.Geometry, Index=subtraction, Wrap=True)
move_4 = Move(Geometry=list_item, Motion=vector_xyz_2.Vector)  # -> Geometry, Transform
list_item_4 = ListItem(List=move.Geometry, Index=subtraction_2, Wrap=True)
vector_xyz_3 = VectorXYZ(XComponent=0, YComponent=material_thickness, ZComponent=0)  # -> Vector, Length
yz_plane_2 = YZPlane(Origin=Point(0, 0, 0))
cluster_5 = Cluster(x_coordinate=cluster_2, x=cluster, y=cluster_3, z=material_thickness, count=expression_3)  # -> geometry, weave_2
replace_items = ReplaceItems(List=move_2.Geometry, Item=move_4.Geometry, Indices="0", Wrap=False)
vector_xyz_4 = VectorXYZ(XComponent=material_thickness, YComponent=0, ZComponent=0)  # -> Vector, Length
move_5 = Move(Geometry=list_item_4, Motion=vector_xyz_4.Vector)  # -> Geometry, Transform
replace_items_2 = ReplaceItems(List=move.Geometry, Item=move_3.Geometry, Indices="0", Wrap=False)
move_6 = Move(Geometry=list_item_3, Motion=vector_xyz_3.Vector)  # -> Geometry, Transform
replace_items_3 = ReplaceItems(List=replace_items, Item=move_6.Geometry, Indices=subtraction, Wrap=False)
weave = Weave(Pattern=[0, 0, 1, 1], Stream0=replace_items_3, Stream1=sub_list.List, NullGaps=False)
point = Point(cluster_5.geometry)
point_2 = Point(cluster_4.point)
mirror_xz = Front(geometry=point_2)
replace_items_4 = ReplaceItems(List=replace_items_2, Item=move_5.Geometry, Indices=subtraction_2, Wrap=False)
mirror_yz = Left(geometry=point)
line_3 = Line(StartPoint=point_2, EndPoint=mirror_xz)
polyline = PolyLine(Vertices=cluster_4.weave_2, Closed=False)
mirror_xz_2 = Front(geometry=polyline)
xz_plane_2 = XZPlane(Origin=Point(0, 0, 0))
weave_2 = Weave(Pattern=[0, 0, 1, 1], Stream0=replace_items_4, Stream1=sub_list_2.List, NullGaps=False)
polyline_2 = PolyLine(Vertices=cluster_5.weave_2, Closed=False)
mirror_yz_2 = Left(geometry=polyline_2)
line_4 = Line(StartPoint=point, EndPoint=mirror_yz)
polyline_3 = PolyLine(Vertices=weave, Closed=False)
polyline_4 = PolyLine(Vertices=weave_2, Closed=False)
mirror_3 = Mirror(Geometry=polyline_4, Plane=xz_plane_2)  # -> Geometry, Transform
mirror_4 = Mirror(Geometry=polyline_3, Plane=yz_plane_2)  # -> Geometry, Transform

back = JoinCurves(Curves=[line_4, polyline_2, mirror_yz_2], Preserve=False)
front = Front(geometry=back)
right = JoinCurves(Curves=[polyline, mirror_xz_2, line_3], Preserve=False)
left = Left(geometry=right)

object_bake = ObjectBake(
    BakeToggle=boolean_toggle,
    GeometryObjects=[back, front, right, left, mirror_4.Geometry, polyline_3, mirror_3.Geometry, polyline_4],
    Layer="GH_Bake",
    ObjectName="GH_Obj",
    ObjectColor=RGB(255, 255, 255),
    LayerColor=RGB(255, 255, 255))

# ==== cluster Front
xz_plane = XZPlane(Origin=Point(0, 0, 0))
geometry = ClusterInput()
mirror = Mirror(Geometry=geometry, Plane=xz_plane)  # -> Geometry, Transform
geometry_2 = ClusterOutput(mirror.Geometry)

# ==== cluster Left
yz_plane = YZPlane(Origin=Point(0, 0, 0))
geometry = ClusterInput()
mirror = Mirror(Geometry=geometry, Plane=yz_plane)  # -> Geometry, Transform
geometry_2 = ClusterOutput(mirror.Geometry)

# ==== cluster Cluster
x = ClusterInput()
y = ClusterInput()
z = ClusterInput()
expression = Expression(x=x, y=y, z=z, Expression="x+y*2-z")
expression_2 = Expression(x=x, y=y, z=z, Expression="x-z")
x_coordinate = ClusterInput()
expression_3 = Expression(x=z, Expression="{-x, 0, 0}")
construct_point = ConstructPoint(XCoordinate=x_coordinate, YCoordinate=expression_2, ZCoordinate=0)
construct_point_2 = ConstructPoint(XCoordinate=x_coordinate, YCoordinate=expression, ZCoordinate=0)
move = Move(Geometry=construct_point_2, Motion=expression_3)  # -> Geometry, Transform
count = ClusterInput()
line = Line(StartPoint=construct_point, EndPoint=construct_point_2)
geometry = ClusterOutput(move.Geometry)
divide_curve = DivideCurve(Curve=line, Count=count, Kinks=False)  # -> Points, Tangents, Parameters
expression_4 = Expression(x=z, Expression="{-x, 0, 0}")
move_2 = Move(Geometry=divide_curve.Points, Motion=expression_4)  # -> Geometry, Transform
list_length = ListLength(List=divide_curve.Points)
expression_5 = Expression(x=list_length, Expression="Format(\"(1, {0})\", x-2)")
sub_list = SubList(List=divide_curve.Points, Domain=expression_5, Wrap=True)  # -> List, Index
weave = Weave(Pattern=[0, 0, 1, 1], Stream0=move_2.Geometry, Stream1=sub_list.List, NullGaps=False)
weave_2 = ClusterOutput(weave)

# ==== cluster Cluster_2
A = ClusterInput()
division = Division(A=A, B="2")
result = ClusterOutput(division)

# ==== cluster Cluster_3
d = ClusterInput()
x = ClusterInput()
x_2 = ClusterInput()
expression = Expression(d=d, w=x, t=x_2, Expression="d+w-t")
y_coordinate = ClusterInput()
expression_2 = Expression(x=x, t=x_2, Expression="x-t")
construct_point = ConstructPoint(XCoordinate=expression_2, YCoordinate=y_coordinate, ZCoordinate=0)
construct_point_2 = ConstructPoint(XCoordinate=expression, YCoordinate=y_coordinate, ZCoordinate=0)
line = Line(StartPoint=construct_point_2, EndPoint=construct_point)
point = ClusterOutput(construct_point_2)
count = ClusterInput()
divide_curve = DivideCurve(Curve=line, Count=count, Kinks=False)  # -> Points, Tangents, Parameters
expression_3 = Expression(x=x_2, Expression="{0, -x, 0}")
move = Move(Geometry=divide_curve.Points, Motion=expression_3)  # -> Geometry, Transform
list_length = ListLength(List=move.Geometry)
expression_4 = Expression(x=list_length, Expression="Format(\"(1, {0})\", x-2)")
sub_list = SubList(List=move.Geometry, Domain=expression_4, Wrap=True)  # -> List, Index
weave = Weave(Pattern=[0, 0, 1, 1], Stream0=divide_curve.Points, Stream1=sub_list.List, NullGaps=False)
weave_2 = ClusterOutput(weave)
