# Grasshopper definition laser box cutout generator.gh (Grasshopper 1.0.8)
# plug-ins: Heteroptera

x_divisions = Slider(3, range=1..8)
y_divisions = Slider(2, range=1..8)
z_divisions = Slider(5, range=1..8)
material_thickness = Slider(3, range=1..6)
width = Slider(55, range=1..100)
depth = Slider(100, range=1..100)
length = Slider(48, range=1..100)
cluster = Cluster_5(x_div=x_divisions, y_div=y_divisions, z_div=z_divisions, A_2=width, A=length, A_3=depth, z=material_thickness)  # -> polyline_4, geometry, polyline_5, geometry_2, line_4, polyline_8, geometry_4, polyline_7, geometry_3, line_2
back = JoinCurves(Curves=[cluster.line_4, cluster.polyline_8, cluster.geometry_4], Preserve=False)
front = Front(geometry=back)
right = JoinCurves(Curves=[cluster.polyline_7, cluster.geometry_3, cluster.line_2], Preserve=False)
left = Left(geometry=right)
bottom = GeometricCell(Curves=[cluster.polyline_4, cluster.geometry, cluster.polyline_5, cluster.geometry_2])

# ==== cluster Front
xz_plane = XZPlane(Origin=Point(0, 0, 0))
geometry = ClusterInput()
mirror = Mirror(Geometry=geometry, Plane=xz_plane)  # -> Geometry, Transform
geometry_2 = ClusterOutput(mirror.Geometry)

# ==== cluster Left
yz_plane = YZPlane(Origin=Point(0, 0, 0))
geometry = ClusterInput()
mirror = Mirror(Geometry=geometry, Plane=yz_plane)  # -> Geometry, Transform
geometry_2 = ClusterOutput(mirror.Geometry)

# ==== cluster Cluster_5
x_div = ClusterInput()
z = ClusterInput()
A = ClusterInput()
A_2 = ClusterInput()
A_3 = ClusterInput()
y_div = ClusterInput()
z_div = ClusterInput()
expression = Expression(x=x_div, Expression="x*2+1")
cluster = Cluster_2(A=A)
cluster_2 = Cluster_2(A=A_2)
cluster_3 = Cluster_2(A=A_3)
expression_2 = Expression(x=y_div, Expression="x*2+1")
expression_3 = Expression(x=z_div, Expression="x*2+1")
cluster_4 = Cluster_3(count_2=expression, x_coordinate=cluster_2, y_coordinate=cluster, x=z, count=expression_2)  # -> weave_3, plane, plane_2, weave_4
cluster_5 = Cluster(x_coordinate=cluster_2, x=cluster, y=cluster_3, z=z, count=expression_3)  # -> geometry, weave_2
cluster_6 = Cluster_4(y_coordinate=cluster, count=expression_3, d=A_3, x=cluster_2, x_2=z)  # -> weave_2, point
point = Point(cluster_5.geometry)
point_2 = Point(cluster_6.point)
mirror_xz = Front(geometry=point_2)
polyline = PolyLine(Vertices=cluster_4.weave_3, Closed=False)
mirror = Mirror(Geometry=polyline, Plane=cluster_4.plane)  # -> Geometry, Transform
polyline_2 = PolyLine(Vertices=cluster_4.weave_4, Closed=False)
mirror_2 = Mirror(Geometry=polyline_2, Plane=cluster_4.plane_2)  # -> Geometry, Transform
mirror_yz = Left(geometry=point)
line = Line(StartPoint=point_2, EndPoint=mirror_xz)
polyline_3 = PolyLine(Vertices=cluster_6.weave_2, Closed=False)
mirror_xz_2 = Front(geometry=polyline_3)
polyline_4 = ClusterOutput(polyline)
polyline_5 = ClusterOutput(polyline_2)
geometry = ClusterOutput(mirror.Geometry)
geometry_2 = ClusterOutput(mirror_2.Geometry)
polyline_6 = PolyLine(Vertices=cluster_5.weave_2, Closed=False)
mirror_yz_2 = Left(geometry=polyline_6)
line_2 = ClusterOutput(line)
line_3 = Line(StartPoint=point, EndPoint=mirror_yz)
polyline_7 = ClusterOutput(polyline_3)
geometry_3 = ClusterOutput(mirror_xz_2)
polyline_8 = ClusterOutput(polyline_6)
line_4 = ClusterOutput(line_3)
geometry_4 = ClusterOutput(mirror_yz_2)

# ==== cluster Cluster
x = ClusterInput()
y = ClusterInput()
z = ClusterInput()
expression = Expression(x=x, y=y, z=z, Expression="x+y*2-z")
expression_2 = Expression(x=x, y=y, z=z, Expression="x-z")
x_coordinate = ClusterInput()
expression_3 = Expression(x=z, Expression="{-x, 0, 0}")
construct_point = ConstructPoint(XCoordinate=x_coordinate, YCoordinate=expression_2, ZCoordinate=0)
construct_point_2 = ConstructPoint(XCoordinate=x_coordinate, YCoordinate=expression, ZCoordinate=0)
move = Move(Geometry=construct_point_2, Motion=expression_3)  # -> Geometry, Transform
count = ClusterInput()
line = Line(StartPoint=construct_point, EndPoint=construct_point_2)
geometry = ClusterOutput(move.Geometry)
divide_curve = DivideCurve(Curve=line, Count=count, Kinks=False)  # -> Points, Tangents, Parameters
expression_4 = Expression(x=z, Expression="{-x, 0, 0}")
move_2 = Move(Geometry=divide_curve.Points, Motion=expression_4)  # -> Geometry, Transform
list_length = ListLength(List=divide_curve.Points)
expression_5 = Expression(x=list_length, Expression="Format(\"(1, {0})\", x-2)")
sub_list = SubList(List=divide_curve.Points, Domain=expression_5, Wrap=True)  # -> List, Index
weave = Weave(Pattern=[0, 0, 1, 1], Stream0=move_2.Geometry, Stream1=sub_list.List, NullGaps=False)
weave_2 = ClusterOutput(weave)

# ==== cluster Cluster_2
A = ClusterInput()
division = Division(A=A, B="2")
result = ClusterOutput(division)

# ==== cluster Cluster_3
x_coordinate = ClusterInput()
y_coordinate = ClusterInput()
construct_point = ConstructPoint(XCoordinate=x_coordinate, YCoordinate=y_coordinate, ZCoordinate=0)
yz_plane = YZPlane(Origin=Point(0, 0, 0))
xz_plane = XZPlane(Origin=Point(0, 0, 0))
mirror = Mirror(Geometry=construct_point, Plane=yz_plane)  # -> Geometry, Transform
mirror_2 = Mirror(Geometry=construct_point, Plane=xz_plane)  # -> Geometry, Transform
line = Line(StartPoint=construct_point, EndPoint=mirror.Geometry)
line_2 = Line(StartPoint=construct_point, EndPoint=mirror_2.Geometry)
x = ClusterInput()
count = ClusterInput()
count_2 = ClusterInput()
expression = Expression(x=x, Expression="{-x, 0, 0}")
expression_2 = Expression(x=x, Expression="{0, -x, 0}")
divide_curve = DivideCurve(Curve=line_2, Count=count, Kinks=False)  # -> Points, Tangents, Parameters
divide_curve_2 = DivideCurve(Curve=line, Count=count_2, Kinks=False)  # -> Points, Tangents, Parameters
list_length = ListLength(List=divide_curve_2.Points)
expression_3 = Expression(x=list_length, Expression="Format(\"(1, {0})\", x-2)")
list_length_2 = ListLength(List=divide_curve.Points)
expression_4 = Expression(x=list_length_2, Expression="Format(\"(1, {0})\", x-2)")
move = Move(Geometry=divide_curve.Points, Motion=expression)  # -> Geometry, Transform
move_2 = Move(Geometry=divide_curve_2.Points, Motion=expression_2)  # -> Geometry, Transform
sub_list = SubList(List=divide_curve_2.Points, Domain=expression_3, Wrap=True)  # -> List, Index
sub_list_2 = SubList(List=divide_curve.Points, Domain=expression_4, Wrap=True)  # -> List, Index
weave = Weave(Pattern=[0, 0, 1, 1], Stream0=move_2.Geometry, Stream1=sub_list.List, NullGaps=False)
xz_plane_2 = XZPlane(Origin=Point(0, 0, 0))
yz_plane_2 = YZPlane(Origin=Point(0, 0, 0))
weave_2 = Weave(Pattern=[0, 0, 1, 1], Stream0=move.Geometry, Stream1=sub_list_2.List, NullGaps=False)
weave_3 = ClusterOutput(weave)
plane = ClusterOutput(xz_plane_2)
plane_2 = ClusterOutput(yz_plane_2)
weave_4 = ClusterOutput(weave_2)

# ==== cluster Cluster_4
d = ClusterInput()
x = ClusterInput()
x_2 = ClusterInput()
expression = Expression(d=d, w=x, t=x_2, Expression="d+w-t")
y_coordinate = ClusterInput()
expression_2 = Expression(x=x, t=x_2, Expression="x-t")
construct_point = ConstructPoint(XCoordinate=expression_2, YCoordinate=y_coordinate, ZCoordinate=0)
construct_point_2 = ConstructPoint(XCoordinate=expression, YCoordinate=y_coordinate, ZCoordinate=0)
line = Line(StartPoint=construct_point_2, EndPoint=construct_point)
point = ClusterOutput(construct_point_2)
count = ClusterInput()
divide_curve = DivideCurve(Curve=line, Count=count, Kinks=False)  # -> Points, Tangents, Parameters
expression_3 = Expression(x=x_2, Expression="{0, -x, 0}")
move = Move(Geometry=divide_curve.Points, Motion=expression_3)  # -> Geometry, Transform
list_length = ListLength(List=move.Geometry)
expression_4 = Expression(x=list_length, Expression="Format(\"(1, {0})\", x-2)")
sub_list = SubList(List=move.Geometry, Domain=expression_4, Wrap=True)  # -> List, Index
weave = Weave(Pattern=[0, 0, 1, 1], Stream0=divide_curve.Points, Stream1=sub_list.List, NullGaps=False)
weave_2 = ClusterOutput(weave)
