# Grasshopper definition laser box generator.gh (Grasshopper 1.0.8)
# plug-ins: LunchBox

material_thickness = Slider(0.25, range=0.1..6)
x_subdivisions = Slider(3, range=1..8)
height = Slider(3, range=1..152.4)
z_subdivisions = Slider(2, range=1..8)
y_subdivisions = Slider(2, range=1..8)
length = Slider(9.5, range=1..254)
width = Slider(18.25, range=1..508)

# ---- group: Bake With Lid
boolean_toggle = BooleanToggle(False)

# ---- group: Bake Without Lid
boolean_toggle_2 = BooleanToggle(True)

# ----
multiplication = Multiplication(A=x_subdivisions, B="2")
division = Division(A=length, B="2")
division_2 = Division(A=height, B="2")
division_3 = Division(A=material_thickness, B="2")
multiplication_2 = Multiplication(A=y_subdivisions, B="2")
division_4 = Division(A=width, B="2")
multiplication_3 = Multiplication(A=z_subdivisions, B="2")
xy_plane = XYPlane(Origin=Point(0, 0, 0))
subtraction = Subtraction(A=division_4, B=division_3)
subtraction_2 = Subtraction(A=division, B=division_3)
construct_point = ConstructPoint(XCoordinate=0, YCoordinate=0, ZCoordinate=division_3)
construct_point_2 = ConstructPoint(XCoordinate=0, YCoordinate=subtraction_2, ZCoordinate=division_2)
construct_point_3 = ConstructPoint(XCoordinate=subtraction, YCoordinate=0, ZCoordinate=division_2)
xz_plane = XZPlane(Origin=Point(0, 0, 0))

bottom = CenterBox(Base=construct_point, X=division_4, Y=division, Z=division_3)
back = CenterBox(Base=construct_point_2, X=division_4, Y=division_3, Z=division_2)
front = Mirror(Geometry=back, Plane=xz_plane)  # -> Geometry, Transform
right = CenterBox(Base=construct_point_3, X=division_3, Y=division, Z=division_2)
left = Mirror(Geometry=right, Plane=PlaneYZ(0, 0, 0))  # -> Geometry, Transform

addition = Addition(A=multiplication_3, B="1")
addition_2 = Addition(A=multiplication, B="1")
addition_3 = Addition(A=multiplication_2, B="1")

solid_intersection = SolidIntersection(BrepsA=bottom, BrepsB=back)
solid_intersection_2 = SolidIntersection(BrepsA=bottom, BrepsB=front.Geometry)

solid_intersection_3 = SolidIntersection(BrepsA=bottom, BrepsB=right)
solid_intersection_4 = SolidIntersection(BrepsA=bottom, BrepsB=left.Geometry)

solid_intersection_5 = SolidIntersection(BrepsA=back, BrepsB=left.Geometry)
solid_intersection_6 = SolidIntersection(BrepsA=back, BrepsB=right)
solid_intersection_7 = SolidIntersection(BrepsA=front.Geometry, BrepsB=right)
solid_intersection_8 = SolidIntersection(BrepsA=front.Geometry, BrepsB=left.Geometry)

longest_edge = LongestEdge(brep=solid_intersection)
longest_edge_2 = LongestEdge(brep=solid_intersection_2)
longest_edge_3 = LongestEdge(brep=solid_intersection_3)
longest_edge_4 = LongestEdge(brep=solid_intersection_4)
longest_edge_5 = LongestEdge(brep=solid_intersection_5)
longest_edge_6 = LongestEdge(brep=solid_intersection_6)
longest_edge_7 = LongestEdge(brep=solid_intersection_7)
longest_edge_8 = LongestEdge(brep=solid_intersection_8)
cluster = Cluster(curve=longest_edge_7, brep=solid_intersection_7, count=addition)  # -> brep_2, result
cluster_2 = Cluster(curve=longest_edge, brep=solid_intersection, count=addition_2)  # -> brep_2, result
cluster_3 = Cluster(curve=longest_edge_2, brep=solid_intersection_2, count=addition_2)  # -> brep_2, result
cluster_4 = Cluster(curve=longest_edge_5, brep=solid_intersection_5, count=addition)  # -> brep_2, result
cluster_5 = Cluster(curve=longest_edge_6, brep=solid_intersection_6, count=addition)  # -> brep_2, result
cluster_6 = Cluster(curve=longest_edge_8, brep=solid_intersection_8, count=addition)  # -> brep_2, result
cluster_7 = Cluster(curve=longest_edge_4, brep=solid_intersection_4, count=addition_3)  # -> brep_2, result
cluster_8 = Cluster(curve=longest_edge_3, brep=solid_intersection_3, count=addition_3)  # -> brep_2, result
linear_array = LinearArray(Geometry=cluster_2.brep_2, Direction=cluster_2.result, Count=addition_2)  # -> Geometry, Transform
linear_array_2 = LinearArray(Geometry=cluster_3.brep_2, Direction=cluster_3.result, Count=addition_2)  # -> Geometry, Transform
linear_array_3 = LinearArray(Geometry=cluster_8.brep_2, Direction=cluster_8.result, Count=addition_3)  # -> Geometry, Transform
linear_array_4 = LinearArray(Geometry=cluster_7.brep_2, Direction=cluster_7.result, Count=addition_3)  # -> Geometry, Transform
linear_array_5 = LinearArray(Geometry=cluster_4.brep_2, Direction=cluster_4.result, Count=addition)  # -> Geometry, Transform
linear_array_6 = LinearArray(Geometry=cluster_5.brep_2, Direction=cluster_5.result, Count=addition)  # -> Geometry, Transform
linear_array_7 = LinearArray(Geometry=cluster.brep_2, Direction=cluster.result, Count=addition)  # -> Geometry, Transform
linear_array_8 = LinearArray(Geometry=cluster_6.brep_2, Direction=cluster_6.result, Count=addition)  # -> Geometry, Transform
dispatch = Dispatch(List=linear_array.Geometry, DispatchPattern=[True, False])  # -> ListA, ListB
dispatch_2 = Dispatch(List=linear_array_3.Geometry, DispatchPattern=[True, False])  # -> ListA, ListB
dispatch_3 = Dispatch(List=linear_array_2.Geometry, DispatchPattern=[True, False])  # -> ListA, ListB
dispatch_4 = Dispatch(List=linear_array_4.Geometry, DispatchPattern=[True, False])  # -> ListA, ListB
dispatch_5 = Dispatch(List=linear_array_5.Geometry, DispatchPattern=[True, False])  # -> ListA, ListB
dispatch_6 = Dispatch(List=linear_array_8.Geometry, DispatchPattern=[True, False])  # -> ListA, ListB
dispatch_7 = Dispatch(List=linear_array_7.Geometry, DispatchPattern=[True, False])  # -> ListA, ListB
dispatch_8 = Dispatch(List=linear_array_6.Geometry, DispatchPattern=[True, False])  # -> ListA, ListB

# ---- group: Bottom
solid_difference = SolidDifference(BrepsA=bottom, BrepsB=dispatch.ListA)
solid_difference_2 = SolidDifference(BrepsA=solid_difference, BrepsB=dispatch_3.ListA)
solid_difference_3 = SolidDifference(BrepsA=solid_difference_2, BrepsB=dispatch_2.ListA)
bottom_complete = SolidDifference(BrepsA=solid_difference_3, BrepsB=dispatch_4.ListA)

# ---- group: Back
solid_difference_4 = SolidDifference(BrepsA=back, BrepsB=dispatch.ListB)
solid_difference_5 = SolidDifference(BrepsA=solid_difference_4, BrepsB=dispatch_5.ListA)
solid_difference_6 = SolidDifference(BrepsA=solid_difference_5, BrepsB=dispatch_8.ListA)

# ---- group: Front
solid_difference_7 = SolidDifference(BrepsA=front.Geometry, BrepsB=dispatch_3.ListB)
solid_difference_8 = SolidDifference(BrepsA=solid_difference_7, BrepsB=dispatch_7.ListA)
solid_difference_9 = SolidDifference(BrepsA=solid_difference_8, BrepsB=dispatch_6.ListA)

# ----
subtraction_3 = Subtraction(A=height, B=material_thickness)

# ---- group: Right
solid_difference_10 = SolidDifference(BrepsA=right, BrepsB=dispatch_2.ListB)
solid_difference_11 = SolidDifference(BrepsA=solid_difference_10, BrepsB=dispatch_8.ListB)
solid_difference_12 = SolidDifference(BrepsA=solid_difference_11, BrepsB=dispatch_7.ListB)

# ----
construct_point_4 = ConstructPoint(XCoordinate=0, YCoordinate=0, ZCoordinate=subtraction_3)

# ---- group: Left
solid_difference_13 = SolidDifference(BrepsA=left.Geometry, BrepsB=dispatch_4.ListB)
solid_difference_14 = SolidDifference(BrepsA=solid_difference_13, BrepsB=dispatch_5.ListB)
solid_difference_15 = SolidDifference(BrepsA=solid_difference_14, BrepsB=dispatch_6.ListB)

# ----
stream_gate = StreamGate(Stream=bottom_complete, Gate=boolean_toggle)  # -> Target0, Target1
expression = Expression(
    x=width,
    y=length,
    z=height,
    w=material_thickness,
    Expression="Format(\"Width: {0}, Length: {1}, Depth: {2}, Thickness: {3}\", x, y, z, w)")

# ---- group: Lid / Lid Cutouts
move = Move(Geometry=stream_gate.Target1, Motion=construct_point_4)  # -> Geometry, Transform
solid_difference_16 = SolidDifference(BrepsA=solid_difference_6, BrepsB=move.Geometry)
solid_difference_17 = SolidDifference(BrepsA=solid_difference_9, BrepsB=move.Geometry)
solid_difference_18 = SolidDifference(BrepsA=solid_difference_12, BrepsB=move.Geometry)
solid_difference_19 = SolidDifference(BrepsA=solid_difference_15, BrepsB=move.Geometry)

# ----
vector_xyz = VectorXYZ(XComponent=0, YComponent=division_4, ZComponent=0)  # -> Vector, Length
object_bake = ObjectBake(
    BakeToggle=boolean_toggle,
    GeometryObjects=[solid_difference_16, solid_difference_17, solid_difference_18, solid_difference_19, move.Geometry, bottom_complete],
    Layer="GH_Bake",
    ObjectName="GH_Obj",
    ObjectColor=RGB(255, 255, 255),
    LayerColor=RGB(255, 255, 255))
object_bake_2 = ObjectBake(
    BakeToggle=boolean_toggle_2,
    GeometryObjects=[bottom_complete, solid_difference_6, solid_difference_9, solid_difference_12, solid_difference_15],
    Layer="GH_Bake",
    ObjectName="GH_Obj",
    ObjectColor=RGB(255, 255, 255),
    LayerColor=RGB(255, 255, 255))
model_layer = ModelLayer()  # -> Layer, Name, Hidden, Locked, DisplayColour, Material, Linetype
text_entity = TextEntity(Plane=xy_plane, Text=expression)  # -> TextEntity, Plane, Text
move_2 = Move(Geometry=text_entity.TextEntity, Motion=vector_xyz.Vector)  # -> Geometry, Transform
object_bake_3 = ObjectBake(
    BakeToggle=False,
    GeometryObjects=move_2.Geometry,
    Layer=model_layer.Layer,
    ObjectName="GH_Obj",
    ObjectColor=RGB(255, 255, 255),
    LayerColor=RGB(255, 255, 255))

# ==== cluster LongestEdge
brep = ClusterInput()
brep_edges = BrepEdges(Brep=brep)  # -> Naked, Interior, NonManifold
length = Length(Curve=brep_edges.Interior)
sort_list = SortList(Keys=length, ValuesValuesA=brep_edges.Interior)  # -> Keys, reverse(ValuesValuesA)
list_item = ListItem(List=sort_list.ValuesValuesA, Index="1", Wrap=True)
i = ClusterOutput(list_item)

# ==== cluster Cluster
brep = ClusterInput()
curve = ClusterInput()
count = ClusterInput()
end_points = EndPoints(Curve=curve)  # -> Start, End
divide_curve = DivideCurve(Curve=curve, Count=count, Kinks=False)  # -> Points, Tangents, Parameters
vector_2pt = Vector2Pt(PointA=end_points.Start, PointB=end_points.End, Unitize=False)  # -> Vector, Length
plane_normal = PlaneNormal(Origin=end_points.Start, ZAxis=vector_2pt.Vector)
division = Division(A=vector_2pt.Vector, B=count)
result = ClusterOutput(division)
move = Move(Geometry=plane_normal, Motion=division)  # -> Geometry, Transform
brep_plane = BrepPlane(Brep=brep, Plane=move.Geometry)  # -> Curves, Points
split_brep = SplitBrep(Brep=brep, Cutter=brep_plane.Curves)
brep_closest_point = BrepClosestPoint(Point=end_points.Start, Brep=split_brep)  # -> Point, Normal, Distance
sort_list = SortList(Keys=brep_closest_point.Distance, ValuesValuesA=split_brep)  # -> Keys, ValuesValuesA
list_item = ListItem(List=sort_list.ValuesValuesA, Index="0", Wrap=True)
cap_holes = CapHoles(Brep=list_item)
brep_2 = ClusterOutput(cap_holes)
